# Grasshopper definition DefinitionVoronoiDisorderedHC.gh (Grasshopper 1.0.8)
# plug-ins: ClipperComponents

path = FilePath("C:\Users\binhn\OneDrive\Desktop\CodeProject\capstone\assetss\csvFile\50x50\numP_314\ratio_0.10\SSI_0.csv")
# Data prep for Voronoi Block
file = ReadFile(File=path, PerLineParse=True)
split = TextSplit(Text=file, Separators="\n")
split_2 = TextSplit(Text=split, Separators=",")
item = ListItem(List=split_2, Index=1, Wrap=True)
item_2 = ListItem(List=split_2, Index=2, Wrap=True)
item_3 = ListItem(List=split_2, Index=0, Wrap=True)
num = Number(item_2)
num_2 = Number(item_3)
num_3 = Number(item)
pt = ConstructPoint(XCoordinate=num_2, YCoordinate=num_3, ZCoordinate=num)  # -> flatten(Point)
path_mapper = PathMapper(pt, source="{A} ", target="{A;0}")

panel = Panel(split)
panel_2 = Panel(pt)
panel_3 = Panel(path_mapper)

# ----
# Extrusion thickness
thickness = Number(50)
Z = UnitZ(Factor=thickness)

thickness_2 = Slider(0.3, range=0..1)
x_inner = Number(50)
y_inner = Number(50)
ligma_thickness = Number(thickness_2)
origin_inner = Point(Point(0, 0, 0))

# ---- group: 20250107
multiplication = Multiplication(A=ligma_thickness, B=2)
# Boundary Prepare
subtraction = Subtraction(A=y_inner, B=multiplication)
subtraction_2 = Subtraction(A=x_inner, B=multiplication)

# ----
external_wall_thickness_offset = Number(multiplication)
rectangle = Rectangle(Plane=origin_inner, XSize=subtraction_2, YSize=subtraction, Radius=0)  # -> Rectangle, Length

# ---- group: 20250107
division = Division(A=external_wall_thickness_offset, B=2)
offset = OffsetCurve(Curve=rectangle.Rectangle, Distance=expr("-x", external_wall_thickness_offset), Plane=origin_inner, Corners=1)
offset_2 = OffsetCurve(Curve=offset, Distance=division, Plane=origin_inner, Corners=1)

# ----
voronoi = Voronoi(Points=path_mapper, Boundary=offset_2, BruteForceOverride=False)
panel_4 = Panel(voronoi)

# ----
# Smart solver for Polygon boundaries
clean = CleanTree(RemoveNulls=True, RemoveInvalid=True, RemoveEmpty=True, Tree=voronoi)
polyoffset = PolylineOffset(
    Polylines=clean,
    Distance=ligma_thickness,
    Plane=Plane(origin=(0, 0, 0), x=(0, 0, 0), y=(0, 0, 0)),
    Tolerance=0.001,
    ClosedFillet=1,
    OpenFillet=1,
    Miter=2)  # -> Contour, Holes

panel_5 = Panel(clean)
crv = Curve(polyoffset.Holes)
panel_6 = Panel(crv)
merge = Merge(Data1=crv, Data2=rectangle.Rectangle)  # -> flatten(Result)
boundary = BoundarySurfaces(Edges=merge)
# Final Block
extr = Extrude(Base=boundary, Direction=Z)
