# Grasshopper definition hexagonalHoneycomb_1.gh (Grasshopper 1.0.8)

domain = Domain(Slider(1, range=0..1))
panel = Panel(domain)
random = Random(Range=domain, Number=1, Seed=2)
rec = Rectangle({Plane=PlaneXY(11.54998956, 6.440710134, 0), Size=Domain2(u=-11.68007085..11.68007085, v=-6.48892825..6.48892825)})
panel_2 = Panel(random)
pop2d = Populate2D(Region=rec, Count=100, Seed=panel_2)
voronoi = Voronoi(Points=pop2d, Boundary=rec, BruteForceOverride=False)
Z = UnitZ(Factor=1)
extr = Extrude(Base=voronoi, Direction=Z)
