# Grasshopper definition hexagonalHoneycomb_2.gh (Grasshopper 1.0.8)

domain = Domain(Slider(1, range=0..1))
panel = Panel(domain)
random = Random(Range=domain, Number=1, Seed=2)
num = Number(50)
pt = Point(Point(0, 0, 0))
num_2 = Number(50)
panel_2 = Panel(random)
rectangle = Rectangle(Plane=pt, XSize=num_2, YSize=num, Radius=0)  # -> Rectangle, Length
pop2d = Populate2D(Region=rectangle.Rectangle, Count=100, Seed=panel_2)
voronoi = Voronoi(Points=pop2d, Boundary=rectangle.Rectangle, BruteForceOverride=False)
Z = UnitZ(Factor=1)
extr = Extrude(Base=voronoi, Direction=Z)
