# Grasshopper definition hexagonalHoneycomb_3.gh (Grasshopper 1.0.8)

pt = Point(Point(0, 0, 0))
external_wall_thickness_offset = Number(1)
num = Number(50)
num_2 = Number(50)
rectangle = Rectangle(Plane=pt, XSize=num, YSize=num_2, Radius=0)  # -> Rectangle, Length
offset = OffsetCurve(Curve=rectangle.Rectangle, Distance=external_wall_thickness_offset, Plane=pt, Corners=1)
pop2d = Populate2D(Region=rectangle.Rectangle, Count=100, Seed=1)
Z = UnitZ(Factor=1)
voronoi = Voronoi(Points=pop2d, Boundary=rectangle.Rectangle, BruteForceOverride=False)
rdiff = RegionDifference(CurvesA=offset, CurvesB=rectangle.Rectangle)
num_3 = Number(0.7)
boundary = BoundarySurfaces(Edges=rdiff)
offset_2 = OffsetCurve(Curve=voronoi, Distance=num_3, Plane=pt, Corners=1)
extr = Extrude(Base=boundary, Direction=Z)
rdiff_2 = RegionDifference()
extr_2 = Extrude(Direction=Z)
boundary_2 = BoundarySurfaces(Edges=offset_2)
