# Grasshopper definition hexagonalHoneycomb_4(Cannot extrude the thickness of wireframe).gh (Grasshopper 1.0.8)

pt = Point(Point(0, 0, 0))
external_wall_thickness_offset = Number(1)
num = Number(50)
num_2 = Number(50)
num_of_points = Number(300)
rectangle = Rectangle(Plane=pt, XSize=num, YSize=num_2, Radius=0)  # -> Rectangle, Length
offset = OffsetCurve(Curve=rectangle.Rectangle, Distance=external_wall_thickness_offset, Plane=pt, Corners=1)
pop2d = Populate2D(Region=rectangle.Rectangle, Count=num_of_points, Seed=1)
rdiff = RegionDifference(CurvesA=offset, CurvesB=rectangle.Rectangle)
num_3 = Number(0.1)
voronoi = Voronoi(Points=pop2d, Boundary=rectangle.Rectangle, BruteForceOverride=False)
boundary = BoundarySurfaces(Edges=rdiff)
Z = UnitZ(Factor=1)
offset_2 = OffsetCurve(Curve=voronoi, Distance=num_3, Plane=pt, Corners=1)
extr = Extrude(Base=boundary, Direction=Z)
rdiff_2 = RegionDifference(CurvesA=rectangle.Rectangle, CurvesB=offset_2)
extr_2 = Extrude(Base=rdiff_2, Direction=Z)
