# Grasshopper definition hexagonalHoneycomb_6(Good_no automation).gh (Grasshopper 1.0.8)

origin_inner = Point(Point(0, 0, 0))
x_inner = Number(50)
y_inner = Number(50)
rectangle = Rectangle(Plane=origin_inner, XSize=x_inner, YSize=y_inner, Radius=0)  # -> Rectangle, Length
external_wall_thickness_offset = Number(1)
num_of_points = Number(300)
pop2d = Populate2D(Region=rectangle.Rectangle, Count=num_of_points, Seed=1)
offset = OffsetCurve(Curve=rectangle.Rectangle, Distance=external_wall_thickness_offset, Plane=origin_inner, Corners=1)
ligma_thickness = Number(0.5)
voronoi = Voronoi(Points=pop2d, Boundary=rectangle.Rectangle, BruteForceOverride=False)
neg = Negative(Value=ligma_thickness)
offset_l = OffsetCurveLoose(Curve=voronoi, Distance=neg)
graft = GraftTree(Tree=offset_l, IncludeEmptyLists=True, IncludeNullItems=True)
cx = CurveSelf(Curve=graft)  # -> Points, Params
shatter = Shatter(Curve=graft, Parameters=cx.Params)
null = NullItem(Item=cx.Params)  # -> NullFlags, InvalidFlags, Description
dispatch = Dispatch(List=graft, DispatchPattern=null.NullFlags)  # -> ListA, ListB
join = JoinCurves(Curves=shatter, Preserve=False)
clean = CleanTree(RemoveNulls=True, RemoveInvalid=True, RemoveEmpty=True, Tree=join)
len = Length(Curve=clean)
sort = SortList(Keys=len, ValuesA=clean)  # -> Keys, reverse(ValuesA)
item = ListItem(List=sort.ValuesA, Index=0, Wrap=True)
merge = Merge(Data1=dispatch.ListA, Data2=item)
clean_2 = CleanTree(RemoveNulls=True, RemoveInvalid=True, RemoveEmpty=False, Tree=merge)
unflatten = UnflattenTree(Tree=clean_2, Guide=offset_l)
match = MatchTree(Tree=unflatten, Guide=offset)
merge_2 = Merge(Data1=match, Data2=offset)
boundary = BoundarySurfaces(Edges=merge_2)
Z = UnitZ(Factor=1)
extr = Extrude(Base=boundary, Direction=Z)
