# Grasshopper definition hexagonalHoneycomb_7(Good_no automation).gh (Grasshopper 1.0.8)

origin_inner = Point(Point(0, 0, 0))
x_inner = Number(50)
y_inner = Number(50)
rectangle = Rectangle(Plane=origin_inner, XSize=x_inner, YSize=y_inner, Radius=0)  # -> Rectangle, Length
external_wall_thickness_offset = Number(1)
path = FilePath("C:\Users\binhn\OneDrive\Desktop\CodeProject\capstone\XTRAWIDE_50x50_n314_0.1_NEW.csv")
file = ReadFile(File=path, PerLineParse=True)
offset = OffsetCurve(Curve=rectangle.Rectangle, Distance=external_wall_thickness_offset, Plane=origin_inner, Corners=1)
ligma_thickness = Number(0.4)
split = TextSplit(Text=file, Separators="\n")
neg = Negative(Value=ligma_thickness)
split_2 = TextSplit(Text=split, Separators=",")
item = ListItem(List=split_2, Index=2, Wrap=True)
item_2 = ListItem(List=split_2, Index=1, Wrap=True)
rdiff = RegionDifference(CurvesA=offset, CurvesB=rectangle.Rectangle)
item_3 = ListItem(List=split_2, Index=0, Wrap=True)
num = Number(item_3)
num_2 = Number(item)
num_3 = Number(item_2)
boundary = BoundarySurfaces(Edges=rdiff)
pt = ConstructPoint(XCoordinate=num, YCoordinate=num_3, ZCoordinate=num_2)  # -> flatten(Point)
path_mapper = PathMapper(pt, source="{A} ", target="{A;0}")
voronoi = Voronoi(Points=path_mapper, Boundary=rectangle.Rectangle, BruteForceOverride=False)
offset_l = OffsetCurveLoose(Curve=voronoi, Distance=neg)
graft = GraftTree(Tree=offset_l, IncludeEmptyLists=True, IncludeNullItems=True)
cx = CurveSelf(Curve=graft)  # -> Points, Params
shatter = Shatter(Curve=graft, Parameters=cx.Params)
null = NullItem(Item=cx.Params)  # -> NullFlags, InvalidFlags, Description
dispatch = Dispatch(List=graft, DispatchPattern=null.NullFlags)  # -> ListA, ListB
join = JoinCurves(Curves=shatter, Preserve=False)
clean = CleanTree(RemoveNulls=True, RemoveInvalid=True, RemoveEmpty=True, Tree=join)
len = Length(Curve=clean)
sort = SortList(Keys=len, ValuesA=clean)  # -> Keys, reverse(ValuesA)
panel = Panel(path_mapper)
item_4 = ListItem(List=sort.ValuesA, Index=0, Wrap=True)
merge = Merge(Data1=dispatch.ListA, Data2=item_4)
clean_2 = CleanTree(RemoveNulls=True, RemoveInvalid=True, RemoveEmpty=False, Tree=merge)
unflatten = UnflattenTree(Tree=clean_2, Guide=offset_l)
thickness = Number(2)
match = MatchTree(Tree=unflatten, Guide=offset)
merge_2 = Merge(Data1=match, Data2=offset)
Z = UnitZ(Factor=thickness)
extr = Extrude(Base=boundary, Direction=Z)
boundary_2 = BoundarySurfaces(Edges=merge_2)
extr_2 = Extrude(Base=boundary_2, Direction=Z)
sdiff = SolidDifference(BrepsA=extr_2, BrepsB=extr)
