# Grasshopper definition hexagonalHoneycomb_8.ghx (Grasshopper 1.0.8)

thickness = Slider(0.3, range=0..1)
x_inner = Number(50)
y_inner = Number(50)
path = FilePath("C:\Users\binhn\OneDrive\Desktop\CodeProject\capstone\assetss\csvFile\size50_50\numP_314\ratio_0.45\points_20250105_191257.csv")
ligma_thickness = Number(thickness)

# ---- group: 20250107
multiplication = Multiplication(A=ligma_thickness, B=2)
subtraction = Subtraction(A=x_inner, B=multiplication)
subtraction_2 = Subtraction(A=y_inner, B=multiplication)

# ----
file = ReadFile(File=path, PerLineParse=True)
external_wall_thickness_offset = Number(multiplication)
origin_inner = Point(Point(0, 0, 0))
split = TextSplit(Text=file, Separators="\n")
split_2 = TextSplit(Text=split, Separators=",")
rectangle = Rectangle(Plane=origin_inner, XSize=subtraction, YSize=subtraction_2, Radius=0)  # -> Rectangle, Length
item = ListItem(List=split_2, Index=1, Wrap=True)
item_2 = ListItem(List=split_2, Index=2, Wrap=True)
item_3 = ListItem(List=split_2, Index=0, Wrap=True)

# ---- group: 20250107
division = Division(A=external_wall_thickness_offset, B=2)
offset = OffsetCurve(Curve=rectangle.Rectangle, Distance=expr("-x", external_wall_thickness_offset), Plane=origin_inner, Corners=1)
offset_2 = OffsetCurve(Curve=offset, Distance=division, Plane=origin_inner, Corners=1)

# ----
num = Number(item_2)
num_2 = Number(item_3)
num_3 = Number(item)
pt = ConstructPoint(XCoordinate=num_2, YCoordinate=num_3, ZCoordinate=num)  # -> flatten(Point)
path_mapper = PathMapper(pt, source="{A} ", target="{A;0}")
crv = Curve(offset)  # disabled
voronoi = Voronoi(Points=path_mapper, Boundary=offset_2, BruteForceOverride=False)
neg = Negative(Value=ligma_thickness)
offset_l = OffsetCurveLoose(Curve=voronoi, Distance=neg)
rdiff = RegionDifference(CurvesA=rectangle.Rectangle, CurvesB=offset)
graft = GraftTree(Tree=offset_l, IncludeEmptyLists=True, IncludeNullItems=True)
cx = CurveSelf(Curve=graft)  # -> Points, Params
boundary = BoundarySurfaces(Edges=rdiff)
shatter = Shatter(Curve=graft, Parameters=cx.Params)
null = NullItem(Item=cx.Params)  # -> NullFlags, InvalidFlags, Description
dispatch = Dispatch(List=graft, DispatchPattern=null.NullFlags)  # -> ListA, ListB
join = JoinCurves(Curves=shatter, Preserve=False)

# ---- group: 20250107
crv_2 = Curve(dispatch.ListA)
len = Length(Curve=join)
larger = LargerThan(FirstNumber=len, SecondNumber=Slider(1, range=0..1))  # -> LargerThan, OrEqualTo
crv_3 = Curve(offset)
pcen = PolygonCenter(Polyline=crv_2)  # -> CenterV, CenterE, CenterA
crv_4 = Curve(crv_3)
cull = CullPattern(List=join, CullPattern=larger.LargerThan)
incurve = PointInCurve(Point=pcen.CenterV, Curve=crv_4)  # -> Relationship, Point
pcen_2 = PolygonCenter(Polyline=cull)  # -> CenterV, CenterE, CenterA
equals = Equality(FirstNumber=incurve.Relationship, SecondNumber=2)  # -> Equality, Inequality
incurve_2 = PointInCurve(Point=pcen_2.CenterV, Curve=crv_3)  # -> Relationship, Point
equals_2 = Equality(FirstNumber=incurve_2.Relationship, SecondNumber=2)  # -> Equality, Inequality
cull_2 = CullPattern(List=crv_2, CullPattern=equals.Equality)
cull_3 = CullPattern(List=cull, CullPattern=equals_2.Equality)

# ----
clean = CleanTree(RemoveNulls=True, RemoveInvalid=True, RemoveEmpty=True, Tree=join)
len_2 = Length(Curve=cull_3)
sort = SortList(Keys=len_2, ValuesA=cull_3)  # -> Keys, reverse(ValuesA)
item_4 = ListItem(List=sort.ValuesA, Index=0, Wrap=True)
match = MatchTree(Tree=item_4, Guide=cull_2)
merge = Merge(Data1=cull_2, Data2=match)  # -> flatten(Result)
clean_2 = CleanTree(RemoveNulls=True, RemoveInvalid=True, RemoveEmpty=True, Tree=merge)
thickness_2 = Number(2)
merge_2 = Merge(Data1=clean_2, Data2=rectangle.Rectangle)
boundary_2 = BoundarySurfaces(Edges=merge_2)
Z = UnitZ(Factor=thickness_2)
extr = Extrude(Base=boundary_2, Direction=Z)
extr_2 = Extrude(Base=boundary, Direction=Z)
sdiff = SolidDifference(BrepsA=extr, BrepsB=extr_2)
